# Requirement set Requirements PET Integration (R2024a)
This document outlines the requirements for developing PET processing and analysis capabilities within Brainstorm. The Brainstorm extension for PET will support importing, processing, registering, visualizing, and analyzing PET data within Brainstorm.
It will be designed to facilitate the analysis of multimodal neuroimaging data by allowing the user to co-analyze MEG, PET and MRI-derived data.
PET will be added as a new data type within Brainstorm and will include PET-specific functions for pre-processing and processing.

## 1 [#3] Functional Requirements (Container)

### 1.1 [#5] User interface (Container)
The current Brainstorm GUI will be extended to facilitate three core steps in PET processing:
1. Importing PET data
2. Processing PET data
3. Co-analyzing PET and MEG data

#### 1.1.1 [#6] Add "Import PET" as a GUI component
Add an "Import PET" item in the subject contextual menu in the Brainstorm tree. The GUI item implement the function "import_pet.m".
Concept:
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
#### 1.1.2 [#114] Select PET file in local dataset

#### 1.1.3 [#73] Add PET as a new data type (Container)
PET will be included as a distinct data type in the Brainstorm tree.
This will feature a PET icon and naming conventions, PET-specific contextual menu and a dialogue box or GUI for processing PET data in Brainsuite and Freesurfer.
The PET data label to the right of the icon must include:
- the name of the tracer
- the number of frames in the PET volume in brackets

#### 1.1.4 [#75] Add a new icon for PET data

#### 1.1.5 [#81] Add a PET popup to the PET data type
Based on the Anatomy popup, the PET popup will have PET-related items:
1. Display --> Overlay PET on MRI
2. Alight PET Frames
3. Calculate SUVR
4. Project SUVR to surface
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
##### 1.1.5.1 [#82] Display
The "Display" GUI items will be identical to the current MRI display items (image below) but will call PET-specific display code from PET visualization functions.
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
##### 1.1.5.2 [#85] Align PET Frames

##### 1.1.5.3 [#83] Register PET to MRI

##### 1.1.5.4 [#86] Calculate SUVR
Launches the process_suvr_pet GUI and calls process_suvr_pet function.

###### 1.1.5.4.1 [#72] Add "Process PET" as a GUI component
The "Calculate SUVR" popup launches a GUI for collecting user-provided parameters for calculating SUVR from PET data.
Conceptual design for PET processing GUI
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
##### 1.1.5.5 [#87] Project SUVR to surface

### 1.2 [#95] PET data type

#### 1.2.1 [#96] Add PET to default formats
Update bst_get to return PetIn as a default format.

#### 1.2.2 [#97] Add PET File Filters
Modify bst_get to add file filters for common PET formats: DICOM, Nifti1, MGH, MNI, Analyze.

#### 1.2.3 [#103] Reference PET metadata in database

##### 1.2.3.1 [#116] Reference PET to Subject

##### 1.2.3.2 [#117] Reference PET to subjectmat

#### 1.2.4 [#105] Create PET structure

##### 1.2.4.1 [#118] Create loadedpet structure for temporary loading

#### 1.2.5 [#106] out_pet_nii

### 1.3 [#104] Add petmat to SQL database

### 1.4 [#8] Import PET (Container)

#### 1.4.1 [#9] Overview (Informational)
A dedicated function for importing PET volumes, based on import_mri.
The import PET functions will include functionalities for:
- file selection via GUI
- format conversions (DICOM, NIFTI etc.)
- naming the imported PET according to tracer
- the importing of multiple PET volumes.
- extracting individual PET frames
- co-registration with MRI
- saving PET volumes in Brainstorm format
- database CRUD for referencing new PET volume in database
- GUI update with new imported PET
- Visualization of imported PET onto the subject MRI

#### 1.4.2 [#89] Parse user inputs
This task is responsible for checking and assigning default values to function inputs if they are not provided.

##### 1.4.2.1 [#90] Default to 'ALL' if not input is provided
'.

##### 1.4.2.2 [#91] Default to 'ALL' if partial input is provided

##### 1.4.2.3 [#92] Use all inputs if all inputs are provided

#### 1.4.3 [#115] Get global variables

#### 1.4.4 [#113] Unzip PET

#### 1.4.5 [#33] Detect PET File Format
Convert PET volume to NIFTI1 if not already in NIFTI1

#### 1.4.6 [#98] Load PET

#### 1.4.7 [#38] Extract the frame count from PET file

#### 1.4.8 [#43] Save imported PET in Brainstorm format

#### 1.4.9 [#44] Reference the newly imported PET file into the Brainstorm database

#### 1.4.10 [#45] Update the GUI tree with the newly imported PET file

##### 1.4.10.1 [#36] Naming of PET file in GUI must include tracer information

##### 1.4.10.2 [#40] Naming of PET file in GUI must include the frame count
Frame count will be included in brackets and shown in the GUI tree.

#### 1.4.11 [#46] Pre-process PET frames (Container)
If imported PET volume contain multiple frames,
1. Align frames to a reference frame
2. Take the voxel-wise mean across the frames
3. Co-register the averaged, aligned PET to subject MRI

##### 1.4.11.1 [#47] Align each frame to a reference frame

##### 1.4.11.2 [#48] Take the voxel-wise mean across the aligned frames

##### 1.4.11.3 [#49] Co-register the averaged, aligned PET to subject MRI

#### 1.4.12 [#51] Visualize the imported and pre-processed PET volume (Container)
The imported and pre-processed PET data will be visualized in the MRI viewer.

##### 1.4.12.1 [#77] Launch MRI viewer

##### 1.4.12.2 [#52] Overlay pre-processed PET onto the subject MRI

###### 1.4.12.2.1 [#78] Define display setting for smoothing, color scheme and intensity normalization.

#### 1.4.13 [#99] Import Brainstorm Format

#### 1.4.14 [#100] Import Nifti Format

#### 1.4.15 [#101] Import DICOM Format

#### 1.4.16 [#102] Import MGH Format

### 1.5 [#88] Import processed PET
A set of functions or code blocks for importing PET and PET derivatives from pipelines implemented outside of Brainstorm, in Brainsuite or Freesurfer.

### 1.6 [#10] Process PET (Container)
PET processing will be performed through pipelines either in Brainsuite or Freesurfer, depending on user selection.
The processing pipelines, whether Brainsuite or Freesurfer, will feature identical processing steps, culminating in the projection of SUVR data onto the subject's reconstructed surface.
The surface projection of SUVR data will be imported back into Brainstorm for analysis and co-visualization with MEG.

#### 1.6.1 [#53] GUI for PET processing (Container)

##### 1.6.1.1 [#54] Dropdown for selecting Brainsuite or Freesurfer

##### 1.6.1.2 [#55] Dropdown or selection list for SUVR reference region

##### 1.6.1.3 [#56] Check box for partial volume correction

###### 1.6.1.3.1 [#65] Default is off

##### 1.6.1.4 [#64] Field for point spread function value

###### 1.6.1.4.1 [#58] Default PSF value is 2.8 (full width at half maximum)

###### 1.6.1.4.2 [#57] Disabled by default, unless PVC check box is on

##### 1.6.1.5 [#59] Check box for parallel processing
Default is off.

###### 1.6.1.5.1 [#63] Default is off

##### 1.6.1.6 [#60] Field for number of threads for parallel processing

###### 1.6.1.6.1 [#61] Default is 1.

###### 1.6.1.6.2 [#62] Disabled by default, unless check box for parallel processing is on.

#### 1.6.2 [#66] Parse user inputs from PET processing GUI

#### 1.6.3 [#11] Export data to Brainsuite and Freesurfer

##### 1.6.3.1 [#67] Pass selected PET volume to Brainsuite or Freesurfer

##### 1.6.3.2 [#68] Pass subject T1 MRI to Brainsuite or Freesurfer

#### 1.6.4 [#12] SUVR Calculation

#### 1.6.5 [#13] Partial Volume Correction

#### 1.6.6 [#69] SUVR Surface Projection

#### 1.6.7 [#70] Import SUVR surface projection into Brainstorm

### 1.7 [#14] Visualize PET (Container)

#### 1.7.1 [#15] Overview (Informational)
Visualization functions will consist of volume and surface-based plotting of PET data. The objective is to allow the user to co-visualize PET data together with MRI (for volumes) and MEG (for surfaces). The visualization functions will include options for smoothing and renormalization of PET data.

### 1.8 [#107] Import PET BIDS (Container)

#### 1.8.1 [#108] Modify process_import_bids to look for PET

#### 1.8.2 [#109] Modify bst_jsonencode to read PET-BIDS

## 2 [#16] Non-functional Requirements (Container)

### 2.1 [#18] Error handling (Informational)
Error handling will be implemented to guide users in case of incorrect inputs or processing failures.

### 2.2 [#19] Contextual tool tips (Informational)
Contextual tooltips will be provided to explain the use of each feature.

### 2.3 [#7] Feedback and notifications (Informational)
GUI should provide feedback for each action (e.g., “Dataset successfully imported,” “PET File Imported”) etc.

### 2.4 [#20] Compatibility (Informational)
The PET toolkit must be fully compatible with the existing Brainstorm architecture and make use of supported MATLAB functions.
The extension will support all major operating systems that Brainstorm supports (Windows, macOS, Linux).

### 2.5 [#21] Open-source (Informational)

### 2.6 [#22] Intuitive interface (Informational)
The added interfaces will be intuitive and navigation will be integrated with established Brainstorm workflows.
Keywords: Intuitive

### 2.7 [#23] Performance (Informational)
The PET toolkit will handle data volumes of varying sizes, from small single-session studies to large longitudinal datasets, without significant lag.
Data processing tasks such as MRI-PET registration and PVC should execute efficiently, leveraging multicore processing where available.

#### 2.7.1 [#24] Memory and processing constraints
- The GUI must not introduce performance bottlenecks or interfere with the existing functionalities of Brainstorm.
- The GUI must operate within the memory and processing constraints of common research workstations.

### 2.8 [#25] Maintainability (Informational)
The code should follow Brainstorm’s development standards and be well-documented to allow for easy maintenance and updates.

## 3 [#26] Test Requirements (Container)

### 3.1 [#80] Test Data Requirements
Test data will be a multimodal dataset, consisting of MEG, MRI and PET imaging.

### 3.2 [#28] Test Cases (Container)

#### 3.2.1 [#29] Nominal Mode Tests (Container)

#### 3.2.2 [#30] Tests for invalid conditions